test file "MIL_SIL_Tests"
  coverage: Decision

suite "MIL_Tests"

  case "Test_RQ_1" [baseline]
    model hand_dryer_controller, harness hand_dryer_controller_Harness
    input "Test_RQ_01" from Test_RQ_01.xlsx, mapped to hand_distance, temp (active)
    baseline "Baseline_RQ_01"
      fanStatus
      heaterStatus

  case "Test_RQ_2" [baseline]
    model hand_dryer_controller, harness hand_dryer_controller_Harness
    input "Test_RQ_02" from Test_RQ_02.xlsx, mapped to hand_distance, temp (active)
    baseline "Baseline_RQ_02"
      fanStatus
      heaterStatus

  case "Test_RQ_3" [baseline]
    model hand_dryer_controller, harness hand_dryer_controller_Harness
    input "Test_RQ_03" from Test_RQ_03.xlsx, mapped to hand_distance, temp (active)
    baseline "Baseline_RQ_03"
      fanStatus
      heaterStatus

  case "Test_RQ_4" [baseline]
    model hand_dryer_controller, harness hand_dryer_controller_Harness
    input "Test_RQ_04" from Test_RQ_04.xlsx, mapped to hand_distance, temp (active)
    baseline "Baseline_RQ_04"
      fanStatus
      heaterStatus

  case "Test_RQ_5" [baseline]
    model hand_dryer_controller, harness hand_dryer_controller_Harness
    input "Test_RQ_05" from Test_RQ_05.xlsx, mapped to hand_distance, temp (active)
    baseline "Sheet1"
      fanStatus
      heaterStatus

  case "Test_RQ_6" [baseline]
    model hand_dryer_controller, harness hand_dryer_controller_Harness
    input "Test_RQ_06" from Test_RQ_06.xlsx, mapped to hand_distance, temp (active)
    baseline "Baseline_RQ_06"
      fanStatus
      heaterStatus

suite "MIL_SIL_Comparison"

  case "Test_RQ_1" [equivalence]
    simulation 1:
      model hand_dryer_controller, harness hand_dryer_controller_Harness
      input "Test_RQ_01" from Test_RQ_01.xlsx, mapped to hand_distance, temp (active)
    simulation 2:
      model hand_dryer_controller, harness hand_dryer_controller_Harness, mode Software-in-the-Loop (SIL)
      input "Test_RQ_01" from Test_RQ_01.xlsx, mapped to hand_distance, temp (active)

  case "Test_RQ_2" [equivalence]
    simulation 1:
      model hand_dryer_controller, harness hand_dryer_controller_Harness
      input "Test_RQ_02" from Test_RQ_02.xlsx, mapped to hand_distance, temp (active)
    simulation 2:
      model hand_dryer_controller, harness hand_dryer_controller_Harness, mode Software-in-the-Loop (SIL)
      input "Test_RQ_02" from Test_RQ_02.xlsx, mapped to hand_distance, temp (active)

  case "Test_RQ_3" [equivalence]
    simulation 1:
      model hand_dryer_controller, harness hand_dryer_controller_Harness
      input "Test_RQ_03" from Test_RQ_03.xlsx, mapped to hand_distance, temp (active)
    simulation 2:
      model hand_dryer_controller, harness hand_dryer_controller_Harness, mode Software-in-the-Loop (SIL)
      input "Test_RQ_03" from Test_RQ_03.xlsx, mapped to hand_distance, temp (active)

  case "Test_RQ_4" [equivalence]
    simulation 1:
      model hand_dryer_controller, harness hand_dryer_controller_Harness
      input "Test_RQ_04" from Test_RQ_04.xlsx, mapped to hand_distance, temp (active)
    simulation 2:
      model hand_dryer_controller, harness hand_dryer_controller_Harness, mode Software-in-the-Loop (SIL)
      input "Test_RQ_04" from Test_RQ_04.xlsx, mapped to hand_distance, temp (active)

  case "Test_RQ_5" [equivalence]
    simulation 1:
      model hand_dryer_controller, harness hand_dryer_controller_Harness
      input "Test_RQ_05" from Test_RQ_05.xlsx, mapped to hand_distance, temp (active)
    simulation 2:
      model hand_dryer_controller, harness hand_dryer_controller_Harness, mode Software-in-the-Loop (SIL)
      input "Test_RQ_05" from Test_RQ_05.xlsx, mapped to hand_distance, temp (active)

  case "Test_RQ_6" [equivalence]
    simulation 1:
      model hand_dryer_controller, harness hand_dryer_controller_Harness
      input "Test_RQ_06" from Test_RQ_06.xlsx, mapped to hand_distance, temp (active)
    simulation 2:
      model hand_dryer_controller, harness hand_dryer_controller_Harness, mode Software-in-the-Loop (SIL)
      input "Test_RQ_06" from Test_RQ_06.xlsx, mapped to hand_distance, temp (active)